# Grasshopper definition constructivo2.gh (Grasshopper 0.9.70)

mesh = Mesh(<mesh referenced from the Rhino model>)
xy = XYPlane(Origin=Point(0, 0, 0))
pln = Plane(xy)
xz = XZPlane(Origin=Point(0, 0, 0))
altura_m_axima_incluido_rocker = Slider(700, range=0..1000)
mshadow = MeshShadow(Mesh=mesh, Light=Vector(0, 0, -1), Plane=pln)
mshadow_2 = MeshShadow(Mesh=mesh, Light=xz, Plane=PlaneXY(0, 0, 0))
distancia_seguridade_rail = Slider(5, range=0..5)
crv = Curve(mshadow)
ancho_material_rail = Slider(-57, range=-100..-20)
crv_2 = Curve(mshadow_2)
Z = UnitZ(Factor=altura_m_axima_incluido_rocker)
offset = Offset(Curve=crv_2, Distance=distancia_seguridade_rail, Plane=xz, Corners=1)
extr = Extrude(Base=crv, Direction=Z)
offset_2 = Offset(Curve=offset, Distance=ancho_material_rail, Plane=xz, Corners=1)
rulesrf = RuledSurface(CurveA=offset_2, CurveB=offset)
Y = UnitY(Factor=Slider(200, range=0..200))
cap = CapHoles(Brep=extr)
extr_2 = Extrude(Base=rulesrf, Direction=Y)
sint = SolidIntersection(BrepsA=cap, BrepsB=extr_2)

wires = BrepWireframe(Brep=sint, Density=-1)
Y_2 = UnitY(Factor=Slider(200, range=200..201))
extr_3 = Extrude(Base=wires, Direction=Y_2)

Y_3 = UnitY(Factor=Slider(593, range=-2001..2000))
move = Move(Geometry=sint, Motion=Y_3)  # -> Geometry, Transform
move_2 = Move(Geometry=extr_3, Motion=Y_3)  # -> Geometry, Transform

xy_2 = XYPlane(Origin=Point(0, 0, 0))
rectangle = Rectangle(Plane=xy_2, XSize=Slider(2195, range=1000..4000), YSize=Slider(190, range=0..300), Radius=0)  # -> Rectangle, Length
X = UnitX(Factor=Slider(-852, range=-2001..2000))

Z_2 = UnitZ(Factor=Slider(813, range=0..2000))
extr_4 = Extrude(Base=rectangle.Rectangle, Direction=Z_2)
cap_2 = CapHoles(Brep=extr_4)

move_3 = Move(Geometry=cap_2, Motion=X)  # -> Geometry, Transform

move_4 = Move(Geometry=move_3.Geometry, Motion=Y_3)  # -> Geometry, Transform
